# Grasshopper definition component.gh (Grasshopper 1.0.7)
# plug-ins: Brain

# Your OpenAI API Key goes here
# Your script description goes here
panel = Panel("A short description of your GH script should be pasted here")
# All your sliders go here
panel_2 = Panel("Paste your API Key here")
# Click on this button to run the component
brain = Brain(API_Key=panel_2, Description=panel, Trigger=Button())
