# Grasshopper definition example.gh (Grasshopper 1.0.7)
# plug-ins: LunchBox, Kangaroo2 Components, Brain

# ----
# THIS IS THE "BRAIN" PLUGIN TEST FILE
grid_type = Slider(2, range=0..3)
base_length = Slider(5000, range=0..10000)
base_width = Slider(2500, range=0..6000)
grid_u = Slider(10, range=0..25)
grid_v = Slider(15, range=0..25)
panel = Panel("The script uses Lunchbox to apply panelling on a base rectangular surface with varying grid types. The script uses a Stream Gate to switch between grid types where 0 is Diamond, 1 is Hexagon, 2 is Quad and 3 is Triangular. The Base U and Base V sliders change the division count in U and V direction. ")
# 2. Test out some of these prompts.
button = Button()
# 1. Paste your API Key in the panel.
brain = Brain(
    Parameters=[grid_type, base_length, base_width, grid_u, grid_v],
    API_Key="Paste your API Key here",
    Description=panel,
    Trigger=button)

integer = Integer(base_length)
# Make it a diamond grid
integer_2 = Integer(base_width)
rectangle = Rectangle(Plane=PlaneXY(0, 0, 0), XSize=integer, YSize=integer_2, Radius=0)  # -> Rectangle, Length
rectangle_2 = Rectangle(rectangle.Rectangle)

rectangle_3 = Rectangle(rectangle_2)
# Make U as 1/3rd of V
integer_3 = Integer(grid_type)
stream_gate = StreamGate(Stream=rectangle_3, Gate=integer_3)  # -> Target0, Target1, Target2, Target3
surface = Surface(stream_gate.Target2)
surface_2 = Surface(stream_gate.Target0)
surface_3 = Surface(stream_gate.Target1)
surface_4 = Surface(stream_gate.Target3)

surface_5 = Surface(surface_2)
integer_4 = Integer(grid_u)
integer_5 = Integer(grid_v)
diamond_panels = DiamondPanels(Surface=surface_5, UDivisions=integer_4, VDivisions=integer_5)  # -> DiamondPanels, TriPanels
merge = Merge(Data1=diamond_panels.DiamondPanels, Data2=diamond_panels.TriPanels)
brep = Brep(merge)

surface_6 = Surface(surface_3)
integer_6 = Integer(grid_u)
integer_7 = Integer(grid_v)
hexagon_cells = HexagonCells(Surface=surface_6, UDivisions=integer_6, VDivisions=integer_7, TParameter=0.25)  # -> HexagonCells, Centers
brep_2 = Brep(hexagon_cells.HexagonCells)

integer_8 = Integer(grid_u)
integer_9 = Integer(grid_v)

surface_7 = Surface(surface)
quad_panels = QuadPanels(Surface=surface_7, UDivisions=integer_8, VDivisions=integer_9)
brep_3 = Brep(quad_panels)

surface_8 = Surface(surface_4)
integer_10 = Integer(grid_u)
# Increase base surface width by 25%
integer_11 = Integer(grid_v)
triangle_panels_c = TrianglePanelsC(Surface=surface_8, UDivisions=integer_10, VDivisions=integer_11)
brep_4 = Brep(triangle_panels_c)

integer_12 = Integer(grid_type)
brep_5 = Brep(brep)
brep_6 = Brep(brep_2)
brep_7 = Brep(brep_3)
brep_8 = Brep(brep_4)
stream_filter = StreamFilter(Gate=integer_12, Stream0=brep_5, Stream1=brep_6, Stream2=brep_7, Stream3=brep_8)
brep_9 = Brep(stream_filter)

brep_10 = Brep(brep_9)
multipipe = MultiPipe(Curves=brep_10, NodeSize=Slider(10, range=0..10), EndOffset=1, StrutSize=1, Segment=0, KinkAngle=0.6, CubeFit=0, Caps=0)
subd = SubD(multipipe)

subd_2 = SubD(subd)
custom_preview = CustomPreview(Geometry=subd_2, Material=ColourSwatch(SwatchColor=RGB(105, 80, 68)))

brep_11 = Brep(brep_9)
custom_preview_2 = CustomPreview(Geometry=brep_11, Material=ColourSwatch(SwatchColor=RGBA(128, 212, 255, 175)))
